# Grasshopper definition folded plates 2020-02-26.gh (Grasshopper 1.0.7)
# plug-ins: MeshEdit Components, Pufferfish, Human, Radical, karambaGH, goat

# ---- group: start curves & control points
# Author: Demi Fang (dfang@mit.edu)
# Github: https://github.mit.edu/dfang/Folded-Plate-Structures/
# 
# Description:
# Define a spanning folded plate geometry.
# Perform structural analysis.
# Optimize input shape and parameters for structural performance.
# 
# Required plug-ins:
# - Karamba (analysis)
# - Design Space Exploration (optimization)
# 
# Blue groups indicate action steps. Follow in sequence.
# 1. Define base curves
# 2. Adjust folded plate parameters
# 3. Optimization (Karamba required)
# 1. DEFINE BASE CURVES
# Two example curves are defined at right.
# Modify by highlighting each "Pt" bucket and moving in Rhino-space
# with Gumball.
# 
# Rules:
# - Curve endpoints MUST remain on xy-plane for working analysis.
# - Curves must have 4 control points each.
# - Each curve should generally span in the x-direction.
# Adjust CPoints of first curve here
# Adjust CPoints of second curve here
pt = Point([Point(-17.84201194, 18, 0), Point(-14.75288323, 14.0517117, 15.8153613), Point(5.350122062, 23.87462266, 18.09369202), Point(3.105261367, 20.87958832, 0)])
pt_2 = Point([Point(-16, -9, 0), Point(-6.275540258, -18.75659934, 15.35064846), Point(2.709114647, -17.75659934, 16.72766975), Point(10, -19.36608535, 0)])
nurbs = NurbsCurve(Vertices=pt, Degree=3, Periodic=False)  # -> Curve, Length, Domain
nurbs_2 = NurbsCurve(Vertices=pt_2, Degree=3, Periodic=False)  # -> Curve, Length, Domain

# ---- group: lofted surface properties
factor_constraining_crease_depth = Panel("0.25")
factor_constraining_z_translation_of_con = Panel(".15")  # "factor constraining z-translation of control pts"

# estimate average max height
divide = DivideCurve(Curve=nurbs_2.Curve, Count=10, Kinks=False)  # -> Points, Tangents, Parameters
divide_2 = DivideCurve(Curve=nurbs.Curve, Count=10, Kinks=False)  # -> Points, Tangents, Parameters
pdecon = Deconstruct(Point=divide.Points)  # -> XComponent, YComponent, ZComponent
pdecon_2 = Deconstruct(Point=divide_2.Points)  # -> XComponent, YComponent, ZComponent
sort = SortList(Keys=pdecon.ZComponent)  # -> reverse(Keys), ValuesA
sort_2 = SortList(Keys=pdecon_2.ZComponent)  # -> reverse(Keys), ValuesA
item = ListItem(List=sort_2.Keys, Index=0, Wrap=True)
item_2 = ListItem(List=sort.Keys, Index=0, Wrap=True)
avr = Average(Input=[item, item_2])
multiplication = Multiplication(A=factor_constraining_crease_depth, B=avr)
multiplication_2 = Multiplication(A=factor_constraining_z_translation_of_con, B=avr)
dom = ConstructDomain(DomainStart=0, DomainEnd=multiplication)
neg = Negative(Value=multiplication_2)
dom_2 = ConstructDomain(DomainStart=neg, DomainEnd=multiplication_2)

# ----
dom_3 = ConstructDomain(DomainStart="-1", DomainEnd=1)

# ---- group: Curve 2 control points (endpoints remain on xy plane)
number_5 = Slider(-0.646, range=-1..1)
number_6 = Slider(-0.898, range=-1..1)
merge = Merge(Data1="0", Data2=number_5, Data3=number_6, Data4="0")
remap = RemapNumbers(Value=merge, Source=dom_3, Target=dom_2)  # -> Mapped, Clipped
vec = VectorXYZ(XComponent=0, YComponent=0, ZComponent=remap.Mapped)  # -> Vector, Length
pt_3 = Point(pt_2)

# ---- group: Curve 1 control points (endpoints remain on xy plane)
# translation of control points for optimization
# constrained based on average height
# These sliders are for optimization only. To
# manually adjust the control points of the
# starting freeform, use "PointsOn" in Rhino
# to drag points and adjust initial geometry.
number_3 = Slider(-1, range=-1..1)
number_4 = Slider(0.934, range=-1..1)
merge_2 = Merge(Data1="0", Data2=number_3, Data3=number_4, Data4="0")
remap_2 = RemapNumbers(Value=merge_2, Source=dom_3, Target=dom_2)  # -> Mapped, Clipped
pt_4 = Point(pt)
vec_2 = VectorXYZ(XComponent=0, YComponent=0, ZComponent=remap_2.Mapped)  # -> Vector, Length

# ---- group: Curve 2 control points after optimization
move = Move(Geometry=pt_3, Motion=vec.Vector)  # -> Geometry, Transform

# ---- group: Curve 1 control points after optimization
move_2 = Move(Geometry=pt_4, Motion=vec_2.Vector)  # -> Geometry, Transform

# ---- group: curves after optimization
nurbs_3 = NurbsCurve(Vertices=move.Geometry, Degree=3, Periodic=False)  # -> Curve, Length, Domain
nurbs_4 = NurbsCurve(Vertices=move_2.Geometry, Degree=3, Periodic=False)  # -> Curve, Length, Domain

# ----
crv = Curve(nurbs_3.Curve)
# lofted surface
# toggle visibility here
crv_2 = Curve(nurbs_4.Curve)
loft = Loft(Curves=[crv_2, crv], Options={Adjust=False, Closed=False, LoftEnds=0, LoftSimp=0, LoftType=0, Rebuild=10, Refit=0.01})

# ---- group: folded plate variables
of_spans = Slider(9, range=2..15)
# 2. ADJUST FOLDED
# PLATE PARAMETERS
span_nodes = Slider(3, range=3..10)
crease_depth = Slider(0.707, range=0..1)

# ----
md_slider = MDSlider(
    SliderMode=0,
    slider_value=Point(0.7317073171, 0.3902439024, 0.5),
    x_domain=Domain(-50, 50),
    y_domain=Domain(-50, 50),
    z_domain=Domain(0, 1))
remap_3 = RemapNumbers(Value=crease_depth, Source=Domain(0, 1), Target=dom)  # -> Mapped, Clipped
n1 = Number(span_nodes)
n2 = Number(of_spans)

# ---- group: major grid points of lofted surface
range = Range(Domain=Domain(0, 1), Steps=n2)
range_2 = Range(Domain=Domain(0, 1), Steps=n1)
pt_5 = ConstructPoint(XCoordinate=graft(range), YCoordinate=flatten(range_2), ZCoordinate=0)
evalsrf = EvaluateSurface(Surface=reparameterize(loft), Point=pt_5)  # -> Point, Normal, UDirection, VDirection, Frame
amp = Amplitude(Vector=evalsrf.Normal, Amplitude=remap_3.Mapped)
move_3 = Move(Geometry=evalsrf.Point, Motion=amp)  # -> Geometry, Transform
pt_6 = Point(evalsrf.Point)

# ---- group: mid grid points of lofted surface
range_3 = Range(Domain=Domain(0, 1), Steps=n1)
range_4 = Range(Domain=Domain(0, 1), Steps=n2)
expression = Expression(x=range_3, N1=n1, Expression="x+1/(2*N1)")
expression_2 = Expression(x=range_4, N2=n2, Expression="x+1/(2*N2)")
split = SplitList(List=expression, Index=n1)  # -> ListA, ListB
split_2 = SplitList(List=expression_2, Index=n2)  # -> ListA, ListB
pt_7 = ConstructPoint(XCoordinate=graft(split_2.ListA), YCoordinate=reverse(flatten(split.ListA)), ZCoordinate=0)
pt_8 = ConstructPoint(XCoordinate=graft(split_2.ListA), YCoordinate=reverse("0"), ZCoordinate=0)
pt_9 = ConstructPoint(XCoordinate=graft(split_2.ListA), YCoordinate=reverse("1"), ZCoordinate=0)
evalsrf_2 = EvaluateSurface(Surface=reparameterize(loft), Point=pt_8)  # -> Point, Normal, UDirection, VDirection, Frame
evalsrf_3 = EvaluateSurface(Surface=reparameterize(loft), Point=pt_7)  # -> Point, Normal, UDirection, VDirection, Frame
evalsrf_4 = EvaluateSurface(Surface=reparameterize(loft), Point=pt_9)  # -> Point, Normal, UDirection, VDirection, Frame
rev = Reverse(Vector=evalsrf_3.Normal)
amp_2 = Amplitude(Vector=rev, Amplitude=remap_3.Mapped)
move_4 = Move(Geometry=evalsrf_3.Point, Motion=amp_2)  # -> Geometry, Transform
addition = Addition(A=n1, B="1")
ins = InsertItems(List=move_4.Geometry, Item=evalsrf_4.Point, Indices="0", Wrap=True)
ins_2 = InsertItems(List=ins, Item=evalsrf_2.Point, Indices=addition, Wrap=True)  # -> reverse(List)

# ---- group: Option 1: Goat optimization (global, evolutionary algorithm recommended as a first pass)
goat = Goat(fitness=avr_2, gene=[span_nodes, of_spans, crease_depth, number_3, number_4, number_5, number_6])

# ---- group: base geometry (lofted surface) as mesh
number_slider = Slider(14, range=5..20)
mesh_uv = MeshSurface(Surface=loft, UCount=number_slider, VCount=number_slider, Overhang=True, Equalize=False)
mesh = Mesh(mesh_uv)

# ---- group: Imperial to Metric conversions
psf_to_kn_m_2 = Panel(".04788")
inch_to_cm = Panel("2.54")

# ---- group: folded plate structure
int = Integer(span_nodes)
python = PythonScript(tree_srf=pt_6, tree_mid=ins_2, u=int)  # -> out, mountains, valleys, mesh; inputs tree_srf: tree of Point3d, tree_mid: tree
# ---------- python: Python ----------
import Rhino.Geometry as rg
import rhinoscriptsyntax as rs

# input tree of surface points (module corners)
# input tree of midpoints (elevated module centers)
# output mountain folds (diagonals)
# output valley folds (span divisions)
# output triangular mesh faces

mountains = []
valleys = []
mesh = []

for i in range(tree_mid.BranchCount):
    branchList1 = tree_srf.Branch(i)
    branchList2 = tree_mid.Branch(i)
    for j in range(u+1):
        pt1 = rs.coerce3dpoint(branchList1[j])
        pt2 = rs.coerce3dpoint(branchList2[j])
        ln = rg.Line(pt1, pt2)
        #mountains.append(ln)
        pt2 = rs.coerce3dpoint(branchList2[j+1])
        ln = rg.Line(pt1, pt2)
        mountains.append(ln)
        pt1 = rs.coerce3dpoint(branchList2[j])
        pt2 = rs.coerce3dpoint(branchList2[j+1])
        ln = rg.Line(pt1, pt2)
        #valleys.append(ln)
        pt1 = rs.coerce3dpoint(branchList2[j])
        pt2 = rs.coerce3dpoint(branchList2[j+1])
        pt3 = rs.coerce3dpoint(branchList1[j])
        ptlist = [pt1, pt2, pt3]
        flist = [[0,1,2]]
        meshy = rs.AddMesh(ptlist, flist)
        mesh.append(meshy)
    for j in range(u):
        pt1 = rs.coerce3dpoint(branchList1[j])
        pt2 = rs.coerce3dpoint(branchList2[j+1])
        pt3 = rs.coerce3dpoint(branchList1[j+1])
        ptlist = [pt1, pt2, pt3]
        flist = [[0,1,2]]
        meshy = rs.AddMesh(ptlist, flist)
        mesh.append(meshy)
        if (i != 0) & (i != tree_srf.BranchCount-1):
            pt1 = rs.coerce3dpoint(branchList1[j])
            pt2 = rs.coerce3dpoint(branchList1[j+1])
            ln = rg.Line(pt1, pt2)
            #valleys.append(ln)        
    branchList1 = tree_srf.Branch(i+1)
    branchList2 = tree_mid.Branch(i)
    for j in range (u+1):
        pt1 = rs.coerce3dpoint(branchList1[j])
        pt2 = rs.coerce3dpoint(branchList2[j])
        ln = rg.Line(pt1, pt2)
        #mountains.append(ln)
        pt2 = rs.coerce3dpoint(branchList2[j+1])
        ln = rg.Line(pt1, pt2)
        #mountains.append(ln)
        pt1 = rs.coerce3dpoint(branchList2[j])
        pt2 = rs.coerce3dpoint(branchList2[j+1])
        pt3 = rs.coerce3dpoint(branchList1[j])
        ptlist = [pt1, pt2, pt3]
        flist = [[0,1,2]]
        meshy = rs.AddMesh(ptlist, flist)
        mesh.append(meshy)
    for j in range(u):
        pt1 = rs.coerce3dpoint(branchList1[j])
        pt2 = rs.coerce3dpoint(branchList2[j+1])
        pt3 = rs.coerce3dpoint(branchList1[j+1])
        ptlist = [pt1, pt2, pt3]
        flist = [[0,1,2]]
        meshy = rs.AddMesh(ptlist, flist)
        mesh.append(meshy)
# ---------- end python ----------

# ---- group: folded plate structure as mesh or brep
mesh_2 = Mesh(python.mesh)

# ---- group: folded plate structure (continued)
explode = MeshExplode(Mesh=mesh_2, Interpolate=False)
demesh = DeconstructMesh(Mesh=explode)  # -> Vertices, Faces, Colours, Normals
pline = PolyLine(Vertices=demesh.Vertices, Closed=True)
boundary = BoundarySurfaces(Edges=pline)
join = BrepJoin(Breps=flatten(boundary))  # -> Breps, Closed

# ---- group: folded plate structure as mesh or brep (continued)
brep = Brep(join.Breps)

# ----
# ANALYSIS
# Uses Karamba components in metric.
# (Values are specified in Imperial but converted before input)
# Assumes steel depth of 1/2".
# load case 0: self wt + wind
# load case 1: self wt + snow
mesh_to_analyze = Mesh(mesh_2)

area = MeshArea(Mesh=mesh_to_analyze)  # -> Area, Centroid
ma = MassAddition(Input=area.Area)  # -> Result, PartialResults
meshtoshell = MeshToShellKaramba3D(Mesh=mesh_to_analyze, LimitDistance_m=0.005)  # -> Element, Points, Info
wind_load_psf = Panel("25")
snow_load_psf = Panel("-50")
steel_thickness_in = Panel("1/2")
multiplication_3 = Multiplication(A=psf_to_kn_m_2, B=wind_load_psf)
multiplication_4 = Multiplication(A=psf_to_kn_m_2, B=snow_load_psf)
multiplication_5 = Multiplication(A=steel_thickness_in, B=inch_to_cm)
X = UnitX(Factor=multiplication_3)
Z = UnitZ(Factor=multiplication_4)
loads = LoadsKaramba3D(Vector=Vector(0, 0, -1), LCase="-1", mode="Gravity")
cross_section = CrossSectionKaramba3D(
    FamilyNameOfCrossSection="DefaultCroSec",
    Material=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,
    Height_cm=multiplication_5,
    mode="Shell - Const")
loads_2 = LoadsKaramba3D(Vector=X, Mesh=mesh_2, LCase="0", mode="MeshLoad -Const.", menu=[buttons(off, off, on), buttons(on, off)])
loads_3 = LoadsKaramba3D(Vector=Z, Mesh=mesh_2, LCase="1", mode="MeshLoad -Const.", menu=[buttons(off, off, on), buttons(on, off)])
matselect = MaterialSelectionKaramba3D(menu=[dropdown(1), dropdown(1)])
load = LoadKaramba3D(flatten([loads, loads_2, loads_3]))

# ---- group: identifies support points as points near z=0. (end points of profile curves must be on the xy plane)
pdecon_3 = Deconstruct(Point=meshtoshell.Points)  # -> XComponent, YComponent, ZComponent
eval = Evaluate(F="If(abs(z)≤0.00001,True, False)", z=pdecon_3.ZComponent)
cull = CullPattern(List=meshtoshell.Points, CullPattern=eval)

# ----
supp = SupportKaramba(PosInd=cull, menu=[buttons(on, on, on, off, off, off)])
assemble = AssembleModelKaramba(Elem=meshtoshell.Element, Support=supp, Load=load, CrossSection=cross_section, Material=matselect, LimitDistance_m=0.005)  # -> Model, Info, Mass_kg, CenterOfGravity
panel = Panel(assemble.Mass_kg)
analyze = AnalyzeKaramba3D(Model=assemble.Model)  # -> CalculatedModel, MaximumDisplacement_cm, ResultingForceOfGravity_kN, ElasticEnergy_kNm
modelview = ModelViewKaramba3D(Model=analyze.CalculatedModel, ResultFactors=1, ResultCase=-1)  # -> Model, DeformedMesh, DeformedAxes, DeformedModel
shellview = ShellViewKaramba3D(Model=modelview.Model, IndexOfLayer=0)  # -> Model, MeshesOfRenderedShells, LegendColors, LegendTags
legend = Legend(Colour=shellview.LegendColors, Tags=shellview.LegendTags, LegendType=1)

# ---- group: objective
mesh_srf_area = Number(ma.Result)
# (3. OPTIMIZATION)
energy = Number(analyze.ElasticEnergy_kNm)
multiplication_6 = Multiplication(A=energy, B=mesh_srf_area)
avr_2 = Average(Input=multiplication_6)
average_se_srf_area_kn_m_3_between_load = Panel(avr_2)  # "average SE * srf area (kN*m^3) between load cases"
se_srf_area_kn_m_3 = Panel(multiplication_6)

# ----
roundd = RoundToDecimalPlace(NumberX=avr_2, DecimalPlace="1", RoundType=0)  # -> Rounded, Difference
concat = Concatenate(FragmentA="Objective: ", FragmentB=roundd.Rounded, FragmentC=" kN-m3")
screentext = ScreenOrientedText(Text=concat, Justification=5, Location=md_slider, SizeFactor=Slider(10, range=1..50), Depth=0, Absolute=False)

# ---- group: Option 2: Radical optimization (gradient-based; recommended for fine-tuning an initial optimization)
radical = Radical(Objective=avr_2, NumericalVariables=[span_nodes, of_spans, crease_depth, number_3, number_4, number_5, number_6])  # -> ObjectiveEvolution, Var, GradientEvolution
